vi "DSBSC.gvi"   [LabVIEW NXG 5.0.0]
panel controls:
  "amplitude_signal": f64 = 1
  "frequency_signal": f64 = 10
  "amplitude_carrier": f64 = 1
  "frequency_carrier": f64 = 10
  "samples": i32 = 1000
  "samples_2": i32 = 1000
  "order": i32 = 2
  "stop": bool
panel indicators:
  "modulating signal_DSBSC": T1
  "demodulated_DSBSC": T1
  "modulating signal_DSBSC_2": waveform<f64>
  "demodulated_DSBSC_2": waveform<f64>
types:
  T1 = cluster{"f0": f64, "df": f64, "magnitude": f64[]}
uses:
  NI::Analysis::Generation::Sine Waveform.gvi
  NI::Analysis::Filtering::Butterworth Lowpass Filter (Waveform).gvi
  NI::Analysis::Measurement::Power Spectral Density for 1 Chan.gvi
diagram:
  while {
    call "Sine Waveform.gvi"(sample rate=50000, samples=$samples, amplitude=$amplitude_signal, frequency=$frequency_signal) -> (sine wave=w1)
    call "Sine Waveform.gvi"(sample rate=50000, samples=$samples_2, amplitude=$amplitude_carrier, frequency=$frequency_carrier) -> (sine wave=w2)
    Waveform Multiply(w1, w2) -> w3
    $"modulating signal_DSBSC_2" <- w3
    Waveform Multiply(w3, w2) -> w4
    call "Butterworth Lowpass Filter (Waveform).gvi"(signal=w4, cutoff frequency=1000, order=$order) -> (filtered signal=w5)
    $demodulated_DSBSC_2 <- w5
    call "Power Spectral Density for 1 Chan.gvi"(signal=w5) -> (power spectral density=w6)
    $demodulated_DSBSC <- w6
    call "Power Spectral Density for 1 Chan.gvi"(signal=w3) -> (power spectral density=w7)
    $"modulating signal_DSBSC" <- w7
    stop if $stop
  }
