vi "SSBSC.gvi"   [LabVIEW NXG 5.0.0]
panel controls:
  "amplitude_signal": f64 = 1
  "frequency_signal": f64 = 10
  "amplitude_carrier": f64 = 1
  "frequency_carrier": f64 = 10
  "samples": i32 = 1000
  "samples_2": i32 = 1000
  "order": i32 = 2
  "stop": bool
  "order_2": i32 = 2
panel indicators:
  "demodulated_SSBSC": waveform<f64>
  "modulating signal_SSBSC_2": waveform<f64>
  "modulating signal_SSBSC_3": T1
  "demodulated_SSBSC_2": T1
types:
  T1 = cluster{"f0": f64, "df": f64, "magnitude": f64[]}
uses:
  NI::Analysis::Generation::Sine Waveform.gvi
  NI::Analysis::Filtering::Butterworth Bandpass Filter (Waveform).gvi
  NI::Analysis::Filtering::Butterworth Lowpass Filter (Waveform).gvi
  NI::Analysis::Measurement::Power Spectral Density for 1 Chan.gvi
diagram:
  while {
    call "Sine Waveform.gvi"(sample rate=50000, samples=$samples, amplitude=$amplitude_signal, frequency=$frequency_signal) -> (sine wave=w1)
    call "Sine Waveform.gvi"(sample rate=50000, samples=$samples_2, amplitude=$amplitude_carrier, frequency=$frequency_carrier) -> (sine wave=w2)
    Waveform Multiply(w1, w2) -> w3
    call "Butterworth Bandpass Filter (Waveform).gvi"(signal=w3, low cutoff frequency=8000, high cutoff frequency=10000, order=$order_2) -> (filtered signal=w4)
    $"modulating signal_SSBSC_2" <- w4
    Waveform Multiply(w4, w2) -> w5
    call "Butterworth Lowpass Filter (Waveform).gvi"(signal=w5, cutoff frequency=1000, order=$order) -> (filtered signal=w6)
    $demodulated_SSBSC <- w6
    call "Power Spectral Density for 1 Chan.gvi"(signal=w6) -> (power spectral density=w7)
    $demodulated_SSBSC_2 <- w7
    call "Power Spectral Density for 1 Chan.gvi"(signal=w4) -> (power spectral density=w8)
    $"modulating signal_SSBSC_3" <- w8
    stop if $stop
  }
