vi "SSBWC.gvi"   [LabVIEW NXG 5.0.0]
panel controls:
  "amplitude_signal_2": f64 = 1
  "frequency_signal_2": f64 = 10
  "amplitude_carrier_2": f64 = 1
  "frequency_carrier_2": f64 = 10
  "samples_3": i32 = 1000
  "samples_4": i32 = 1000
  "order_2": i32 = 2
  "stop_2": bool
  "order": i32 = 2
panel indicators:
  "demodulated_SSBWC": waveform<f64>
  "Modulating_SSBWC": waveform<f64>
  "Modulating_SSBWC_2": T1
  "demodulated_SSBWC_2": T1
types:
  T1 = cluster{"f0": f64, "df": f64, "magnitude": f64[]}
uses:
  NI::Analysis::Generation::Sine Waveform.gvi
  NI::Analysis::Filtering::Butterworth Lowpass Filter (Waveform).gvi
  NI::Analysis::Measurement::Power Spectral Density for 1 Chan.gvi
  NI::Analysis::Filtering::Butterworth Bandpass Filter (Waveform).gvi
diagram:
  while {
    call "Sine Waveform.gvi"(sample rate=50000, samples=$samples_4, amplitude=$amplitude_carrier_2, frequency=$frequency_carrier_2) -> (sine wave=w1)
    call "Sine Waveform.gvi"(sample rate=50000, samples=$samples_3, amplitude=$amplitude_signal_2, frequency=$frequency_signal_2) -> (sine wave=w2)
    Waveform Multiply(w2, w1) -> w3
    Waveform Add(w3, w1) -> w4
    Waveform Multiply(w4, w1) -> w5
    call "Butterworth Lowpass Filter (Waveform).gvi"(signal=w5, cutoff frequency=1500, order=$order_2) -> (filtered signal=w6)
    $demodulated_SSBWC <- w6
    call "Power Spectral Density for 1 Chan.gvi"(signal=w6) -> (power spectral density=w7)
    $demodulated_SSBWC_2 <- w7
    call "Butterworth Bandpass Filter (Waveform).gvi"(signal=w4, low cutoff frequency=8500, high cutoff frequency=10500, order=$order) -> (filtered signal=w8)
    $Modulating_SSBWC <- w8
    call "Power Spectral Density for 1 Chan.gvi"(signal=w8) -> (power spectral density=w9)
    $Modulating_SSBWC_2 <- w9
    stop if $stop_2
  }
